# Grasshopper definition testFile.gh (Grasshopper 0.9.76)
# plug-ins: VirtualWindTunnel

wind_dir = ControlKnob(Decimals=0, Limit=True, Maximum=359, Minimum=0, Range=360, Value=0)
# 1. this is where you start!
panel = Panel("C:\Users\Patrick Kastner\Box Sync\BPACS2018\obstacles\closed\cpPaper4524_0_rhino\")
abl = ABL(
    WDir=wind_dir,
    Uref=Slider(12, range=1..100),
    Zref=Slider(9, range=0..100),
    Z0=Slider(1, range=1..100),
    ZGround=Slider(0, range=0..100))
geo = Geometry([<brep referenced from the Rhino model> x3])
clean = Clean(Run=Button())
clean_2 = Clean(Dir="C:\MeshingPaper\Niigata_case_ref_app_dimensions_comp\", Run=Button())
domain = Domain(
    Geometry=geo,
    Directory="C:\MeshingPaper\case_ref_app_dimensions_comp\",
    Mode=1,
    BaseMesh=Slider(39, range=0..100),
    RAM=Slider(1, range=0..64000),
    CPUs=Slider(1, range=1..8),
    Run=Toggle(False))  # -> Out, Domain, Cyl, D, E
domaincyl = DomainCyl(
    Geometry=geo,
    Directory=panel,
    BCond=abl,
    DivisionsOuterCirc=Slider(6, range=0..100),
    GradingPerim=Slider(5, range=0..100),
    ScaleInnerR=Slider(29, range=0..100),
    RAM=2000,
    CPUs=1,
    Run=Toggle(True))  # -> Out, Domain, Cyl
panel_2 = Panel(domain.Domain)
c_script = CSharpScript()  # -> Out, A
number_slider = Slider(2, range=0..10)
number_slider_2 = Slider(1, range=0..10)
pt = Point(<point referenced from the Rhino model>)
cellsize = CellSize(Domain=domain.Domain, Size="20.0", DesiredCellSize="1")
vec = VectorXYZ(XComponent=Slider(100, range=0..100), YComponent=Slider(0, range=0..100), ZComponent=Slider(97, range=0..100))  # -> Vector, Length
panel_3 = Panel(cellsize)
mesh = Mesh(
    Domain=domaincyl.Domain,
    AccBuilding=number_slider,
    AccFeatures=number_slider,
    AccRefinement=number_slider,
    AccGround=number_slider_2,
    NLayer=number_slider_2,
    Run=Toggle(True))  # -> Out, Domain
mesh_2 = Mesh(Domain=domain.Domain, Accuracy=panel_3, Run=Toggle(True), Run_2=False)  # -> Out, Domain
box = Box2Pt(PointA=pt, PointB=vec.Vector, Plane=PlaneXY(0, 0, 0))
panel_4 = Panel(mesh_2.Domain)  # disabled
mesh_3 = Mesh(box)
demesh = DeconstructMesh(Mesh=mesh_3)  # -> Vertices, Faces, Colours, Normals
number_slider_3 = Slider(5, range=0..10)  # disabled
number_slider_4 = Slider(5, range=0..100)  # disabled
number_slider_5 = Slider(10, range=0..1000)  # disabled
toggle = BooleanToggle(False)  # disabled
probes = Probes(Domain=mesh.Domain, Points=demesh.Vertices, Mode=1, Run=Toggle(True))
simulation = Simulation(
    Domain=mesh.Domain,
    Iterations=Slider(1000, range=0..1000),
    WriteInterval=Slider(5, range=0..100),
    KeepTimeSteps=Slider(5, range=0..10),
    Run_2=Toggle(True))
gradient = Gradient(
    LowerLimit=0,
    UpperLimit=1,
    stops=[0: RGB(234, 38, 0), 0.25: RGB(234, 126, 0), 0.463: RGB(254, 244, 84), 0.75: RGB(173, 203, 249), 1: RGB(75, 107, 169)])  # disabled
simulation_2 = Simulation(
    Domain=mesh_2.Domain,
    Iterations=number_slider_5,
    WriteInterval=number_slider_4,
    KeepTimeSteps=number_slider_3,
    Run=toggle,
    Run_2=False)  # disabled
vdisex = VectorDisplayEx(Colour=gradient, Width=2)  # disabled
